# Grasshopper definition test.gh (Grasshopper 1.0.7)
# plug-ins: MyGrasshopperPlugIn

number_slider = Slider(3, range=1..5)
number_slider_2 = Slider(8, range=1..15)
multiplication = Multiplication(A=number_slider, B=number_slider_2)
test = TestPython(TextToLower="Hello", TextToUpper="world")
python = StartPythonComponent(UserMode="false", StartPython=Toggle(True), LogLevel="Debug", TimeOut=Slider(10, range=5..20))
series = Series(Start=1, Step=1, Count=multiplication)
dostuffinpython = ACSharpPythonGrasshopperComponent(AListOfNumbers=series, RowNumber=number_slider, ColumnsNumber=number_slider_2)
panel = Panel(dostuffinpython)
